# Grasshopper definition test_rectangle.ghx (Grasshopper 1.0.8)

series = Series(Start="1000", Step="1000", Count=10)
pt = ConstructPoint(XCoordinate="0", YCoordinate="0", ZCoordinate="2500")
pt_2 = ConstructPoint(XCoordinate="0", YCoordinate="0", ZCoordinate="1000")
X = UnitX(Factor=series)
ln = Line(StartPoint=pt_2, EndPoint=pt)
move = Move(Geometry=pt_2, Motion=X)  # -> Geometry, Transform
neg = Negative(Value="250")
xy = XYPlane(Origin=move.Geometry)
dom = ConstructDomain(DomainStart=neg, DomainEnd="250")
rectangle = Rectangle(Plane=xy, XSize=dom, YSize=dom, Radius=0)  # -> Rectangle, Length
srf = Surface(rectangle.Rectangle)
swp1 = Sweep1(Rail=ln, Sections=graft(srf), Miter=1)
