# Grasshopper definition test4.ghx (Grasshopper 1.0.7)

breedte = Slider(2500, range=1000..6500)
lengte = Slider(4000, range=4000..26000)
division = Division(A=breedte, B="2")
toog = Slider(200, range=100..1000)
subtraction = Subtraction(A=division, B="150")
neg = Negative(Value=subtraction)
division_2 = Division(A=neg, B="1")
subtraction_2 = Subtraction(A=neg, B="150")
addition = Addition(A=neg, B="150")
subtraction_3 = Subtraction(A="0", B="25")
subtraction_4 = Subtraction(A="0", B="25")
division_3 = Division(A=lengte, B="2")
division_4 = Division(A=lengte, B="50")
division_5 = Division(A=lengte, B="2")
division_6 = Division(A=lengte, B="50")
addition_2 = Addition(A=subtraction_3, B=toog)
addition_3 = Addition(A="25", B=division_4)
addition_4 = Addition(A=subtraction_4, B=toog)
addition_5 = Addition(A="25", B=division_6)
subtraction_5 = Subtraction(A=toog, B=addition_3)
subtraction_6 = Subtraction(A=subtraction, B=division_4)
pt = ConstructPoint(XCoordinate="0", YCoordinate=subtraction, ZCoordinate=subtraction_3)
pt_2 = ConstructPoint(XCoordinate="0", YCoordinate=division, ZCoordinate="0")
pt_3 = ConstructPoint(XCoordinate=division_3, YCoordinate=subtraction, ZCoordinate=addition_2)
pt_4 = ConstructPoint(XCoordinate=division_3, YCoordinate=division, ZCoordinate=toog)
pt_5 = ConstructPoint(XCoordinate=lengte, YCoordinate=subtraction, ZCoordinate=subtraction_3)
pt_6 = ConstructPoint(XCoordinate=lengte, YCoordinate=division, ZCoordinate="0")
pt_7 = ConstructPoint(XCoordinate="0", YCoordinate=division, ZCoordinate=subtraction_3)
pt_8 = ConstructPoint(XCoordinate=division_3, YCoordinate=division, ZCoordinate=addition_2)
pt_9 = ConstructPoint(XCoordinate=lengte, YCoordinate=division, ZCoordinate=subtraction_3)
subtraction_7 = Subtraction(A=toog, B=addition_5)
subtraction_8 = Subtraction(A=addition, B=division_6)
addition_6 = Addition(A=neg, B=division_6)
pt_10 = ConstructPoint(XCoordinate="0", YCoordinate=neg, ZCoordinate=subtraction_4)
pt_11 = ConstructPoint(XCoordinate=division_5, YCoordinate=neg, ZCoordinate=addition_4)
pt_12 = ConstructPoint(XCoordinate=lengte, YCoordinate=neg, ZCoordinate=subtraction_4)
neg_2 = Negative(Value=addition_3)
neg_3 = Negative(Value=addition_5)
pt_13 = ConstructPoint(XCoordinate="0", YCoordinate=subtraction_2, ZCoordinate=subtraction_4)
pt_14 = ConstructPoint(XCoordinate=division_5, YCoordinate=subtraction_2, ZCoordinate=addition_4)
pt_15 = ConstructPoint(XCoordinate="0", YCoordinate=subtraction_2, ZCoordinate="0")
pt_16 = ConstructPoint(XCoordinate=lengte, YCoordinate=subtraction_2, ZCoordinate=subtraction_4)
pt_17 = ConstructPoint(XCoordinate=division_5, YCoordinate=subtraction_2, ZCoordinate=toog)
pt_18 = ConstructPoint(XCoordinate=lengte, YCoordinate=subtraction_2, ZCoordinate="0")
arc = Arc3Pt(PointA=pt, PointB=pt_3, PointC=pt_5)  # -> Arc, Plane, Radius
arc_2 = Arc3Pt(PointA=pt_2, PointB=pt_4, PointC=pt_6)  # -> Arc, Plane, Radius
arc_3 = Arc3Pt(PointA=pt_7, PointB=pt_8, PointC=pt_9)  # -> Arc, Plane, Radius
arc_4 = Arc3Pt(PointA=pt_10, PointB=pt_11, PointC=pt_12)  # -> Arc, Plane, Radius
pt_19 = ConstructPoint(XCoordinate="0", YCoordinate=subtraction_6, ZCoordinate=neg_2)
pt_20 = ConstructPoint(XCoordinate=division_3, YCoordinate=subtraction_6, ZCoordinate=subtraction_5)
pt_21 = ConstructPoint(XCoordinate=lengte, YCoordinate=subtraction_6, ZCoordinate=neg_2)
pt_22 = ConstructPoint(XCoordinate="0", YCoordinate=addition_6, ZCoordinate=neg_3)
pt_23 = ConstructPoint(XCoordinate=division_5, YCoordinate=addition_6, ZCoordinate=subtraction_7)
pt_24 = ConstructPoint(XCoordinate=lengte, YCoordinate=addition_6, ZCoordinate=neg_3)
arc_5 = Arc3Pt(PointA=pt_13, PointB=pt_14, PointC=pt_16)  # -> Arc, Plane, Radius
arc_6 = Arc3Pt(PointA=pt_15, PointB=pt_17, PointC=pt_18)  # -> Arc, Plane, Radius
arc_7 = Arc3Pt(PointA=pt_19, PointB=pt_20, PointC=pt_21)  # -> Arc, Plane, Radius
arc_8 = Arc3Pt(PointA=pt_22, PointB=pt_23, PointC=pt_24)  # -> Arc, Plane, Radius
rulesrf = RuledSurface(CurveA=arc_4.Arc, CurveB=arc_5.Arc)
rulesrf_2 = RuledSurface(CurveA=arc_2.Arc, CurveB=arc_3.Arc)
rulesrf_3 = RuledSurface(CurveA=arc_5.Arc, CurveB=arc_6.Arc)
rulesrf_4 = RuledSurface(CurveA=arc_3.Arc, CurveB=arc.Arc)
rulesrf_5 = RuledSurface(CurveA=arc.Arc, CurveB=arc_7.Arc)
rulesrf_6 = RuledSurface(CurveA=arc_4.Arc, CurveB=arc_8.Arc)
rulesrf_7 = RuledSurface(CurveA=arc_7.Arc, CurveB=arc_8.Arc)
rulesrf_8 = RuledSurface(CurveA=arc_2.Arc, CurveB=arc_6.Arc)
material = CreateMaterial(Diffuse="56;62;66", Specular="255;255;255", Emission="0;0;0", Transparency="0", Shine="10")
material_2 = CreateMaterial(Diffuse="220;220;220", Specular="255;255;255", Emission="0;0;0", Transparency="0", Shine="10")
preview = CustomPreview(Geometry=[rulesrf_2, rulesrf_4, rulesrf_5, rulesrf_7, rulesrf_6, rulesrf, rulesrf_3], Material=material)
preview_2 = CustomPreview(Geometry=rulesrf_8, Material=material_2)
neg_4 = Negative(Value="70")
Y = UnitY(Factor=neg_4)
move = Move(Geometry=arc_2.Arc, Motion=Y)  # -> Geometry, Transform
len = Length(Curve=move.Geometry)
division_7 = Division(A=len, B="1500")
round = Round(Number=division_7)  # -> Nearest, Floor, Ceiling
divide = DivideCurve(Curve=move.Geometry, Count=round.Nearest, Kinks=False)  # -> Points, Tangents, Parameters
Z = UnitZ(Factor="1000")
move_2 = Move(Geometry=divide.Points, Motion=Z)  # -> Geometry, Transform
ln = Line(StartPoint=divide.Points, EndPoint=move_2.Geometry)
